# Requirement set cruiseControlRBTCovReqs (R2020a)

## 1 [SET_SPEED] SET button locks set speed
The cruise control shall set the target speed to the current speed when the Set button is pressed.

## 2 [BRAKE] BRAKE disengages cruise control
The cruise control shall deactivate when a braking event has been detected.

## 3 [ACTIVATE] ACTIVATE cruise control when enabled, speed set, and no brake
The cruise control shall activate when enabled, the Set button is pressed, and the brake is not engaged.

## 4 [INCREMENT] INCREMENT button increases set speed
The cruise control shall increase the target speed when the Increment button is pressed.

## 5 [DECREMENT] DECREMENT button decreases set speed
The cruise control shall decrease the target speed when the Decrement button is pressed.

## 6 [THROTTLE] THROTTLE applied smoothly if speed differs from target
The cruise control shall limit throttle rate of change to +/- 1 radian per second.